# Grasshopper definition filterworkdesignerforui-safe.gh (Grasshopper 1.0.8)
# plug-ins: Pufferfish

# ----
# UI
ngonalprism_level = Slider(9, range=0..20)
lens_thickness = Slider(79, range=0..100)
triprism_level = Slider(21, range=10..28)
quadprism_level = Slider(200, range=200..400)
base_height = Slider(0.6, range=0..1)
mask_start = Slider(0, range=0..100)
mask_angle = Slider(0, range=0..360)
hole_size = Slider(0, range=0..100)
mask_end = Slider(45, range=0..88)
halo_level = Slider(19.7, range=0..20)

maskstart = GetNumber(mask_start, AtLeast=1, AtMost=1, Maximum=1.797693135e+308, Minimum=-1.797693135e+308, TreeAccess=False)
lensthickness = GetNumber(lens_thickness, AtLeast=1, AtMost=1, Maximum=1.797693135e+308, Minimum=-1.797693135e+308, TreeAccess=False)
holesize = GetNumber(hole_size, AtLeast=1, AtMost=1, Maximum=1.797693135e+308, Minimum=-1.797693135e+308, TreeAccess=False)
maskend = GetNumber(mask_end, AtLeast=1, AtMost=1, Maximum=1.797693135e+308, Minimum=-1.797693135e+308, TreeAccess=False)
maskangle = GetNumber(mask_angle, AtLeast=1, AtMost=1, Maximum=1.797693135e+308, Minimum=-1.797693135e+308, TreeAccess=False)
halolevel = GetNumber(halo_level, AtLeast=1, AtMost=1, Maximum=1.797693135e+308, Minimum=-1.797693135e+308, TreeAccess=False)
quadprismlevel = GetNumber(quadprism_level, AtLeast=1, AtMost=1, Maximum=1.797693135e+308, Minimum=-1.797693135e+308, TreeAccess=False)
triprismlevel = GetNumber(triprism_level, AtLeast=1, AtMost=1, Maximum=1.797693135e+308, Minimum=-1.797693135e+308, TreeAccess=False)
ngonalprismlevel = GetNumber(ngonalprism_level, AtLeast=1, AtMost=1, Maximum=1.797693135e+308, Minimum=-1.797693135e+308, TreeAccess=False)
baseheight = GetNumber(base_height, AtLeast=1, AtMost=1, Maximum=1.797693135e+308, Minimum=-1.797693135e+308, TreeAccess=False)
# Bokeh Controller
number_slider = Slider(10, range=0..10)

# ----
# Plates
number_slider_2 = Slider(90, range=0..100)
rectangle = Rectangle(Plane=PlaneXY(0, 0, 20), XSize=number_slider_2, YSize=number_slider_2, Radius=0)  # -> Rectangle, Length
boxrec = BoxRectangle(Rectangle=rectangle.Rectangle, Height=Domain(0, 40))
cyl = Cylinder(Base=PlaneXY(45, 45, -1), Radius=holesize, Length=20)
rectangle_2 = Rectangle(Plane=PlaneXY(0, 0, 0), XSize=number_slider_2, YSize=number_slider_2, Radius=0)  # -> Rectangle, Length
neg = Negative(Value=halolevel)
cap = CapHoles(Brep=cyl)
boxrec_2 = BoxRectangle(Rectangle=rectangle_2.Rectangle, Height=baseheight)
Z = UnitZ(Factor=neg)
move = Move(Geometry=boxrec, Motion=Z)  # -> Geometry, Transform

# ----
# Convex
number_slider_3 = Slider(45, range=0..100)
pt = ConstructPoint(XCoordinate=88, YCoordinate=number_slider_3, ZCoordinate=baseheight)
pt_2 = ConstructPoint(XCoordinate=2, YCoordinate=number_slider_3, ZCoordinate=baseheight)
pt_3 = ConstructPoint(XCoordinate=number_slider_3, YCoordinate=number_slider_3, ZCoordinate=lensthickness)
pt_4 = ConstructPoint(XCoordinate=number_slider_3, YCoordinate=88, ZCoordinate=baseheight)
pt_5 = Point(pt)
pt_6 = Point(pt_4)
pt_7 = Point(pt_2)
pt_8 = Point(pt_3)
sph4pt = Sphere4Pt(Point1=pt_5, Point2=pt_6, Point3=pt_7, Point4=pt_8)  # -> Center, Radius, Sphere
sdiff = SolidDifference(BrepsA=sph4pt.Sphere, BrepsB=boxrec_2)
item = ListItem(List=sdiff, Index=0, Wrap=True)

# ----
# Prism
pt_9 = ConstructPoint(XCoordinate=number_slider_3, YCoordinate=number_slider_3, ZCoordinate=baseheight)
pt_10 = Point(pt_9)
cone = Cone(Base=pt_10, Radius=Slider(43, range=0..100), Length=lensthickness)  # -> Cone, Tip
cap_2 = CapHoles(Brep=cone.Cone)

cone_2 = Cone(Base=pt_10, Radius=number_slider, Length=lensthickness)  # -> Cone, Tip
bbox = BoundingBox(Content=cone_2.Cone, Plane=PlaneXY(0, 0, 0))  # -> Box, Box_2

# ----
# NgonalPrism
number_slider_4 = Slider(43, range=0..100)
pt_11 = Point(Point(45, 45, 0.6))
cir = Circle(Plane=pt_11, Radius=number_slider_4)
divide = DivideCurve(Curve=cir, Count=ngonalprismlevel, Kinks=False)  # -> Points, Tangents, Parameters
pline = PolyLine(Vertices=divide.Points, Closed=True)
boundary = BoundarySurfaces(Edges=pline)
extr = ExtrudePoint(Base=boundary, Point=pt_3)

debox = DeconstructBox(Box=bbox.Box)  # -> Plane, X, Y, Z
rectangle_3 = Rectangle(Plane=PlaneXY(0, 0, 0), XSize=debox.X, YSize=debox.Y, Radius=0)  # -> Rectangle, Length
arrrec = RectangularArray(Geometry=cone_2.Cone, Cell=rectangle_3.Rectangle, XCount=Slider(10, range=0..10), YCount=Slider(10, range=0..10))  # -> Geometry, Transform
join = BrepJoin(Breps=arrrec.Geometry)  # -> Breps, Closed
bbox_2 = BoundingBox(Content=join.Breps, Plane=PlaneXY(0, 0, 0))  # -> Box, Box_2
panel = Panel("0 to 1")
debrep = DeconstructBrep(Brep=item)  # -> Faces, Edges, Vertices
list = ValueList({"Convex": 0, "Prism": 1, "TriPrism": 2, "HexaPrism": 3, "QuadPrism": 4, "NgonalPrism": 5}, selected="NgonalPrism")
item_2 = ListItem(List=debrep.Faces, Index=Slider(0, range=0..10), Wrap=True)
srfmorph = SurfaceMorph(Geometry=join.Breps, Reference=bbox_2.Box, Surface=reparameterize(item_2), UDomain=bbox_2.Box, VDomain=bbox_2.Box)
lensselector = GetString(list, AtLeast=1, AtMost=1, TreeAccess=False)
gate = StreamGate(Stream=item, Gate=lensselector)  # -> Target0, Target1, Target2, Target3, Target4, Target5

# ----
# TriPrism/HexaPrism
triremesh = TriRemesh(Geometry=[gate.Target2, gate.Target3], Length=triprismlevel, Iterations=100)  # -> Triangulation, Dual, Creases
msh2psrf = MeshToPolysurface(Mesh=triremesh.Triangulation, Triangles=False, FaceMerge=False)
msh2psrf_2 = MeshToPolysurface(Mesh=triremesh.Dual, Triangles=False, FaceMerge=False)

# ----
# QuadPrism
qrsettings = QuadRemeshSettings(TargetCount=quadprismlevel, AdaptiveSize=0, AdaptiveCount=False, HardEdges=True, SeamEdges=1, Symmetry=0, GuideCurves=0)
qrmesh = QuadRemesh(Geometry=gate.Target4, Settings=qrsettings)
msh2psrf_3 = MeshToPolysurface(Mesh=qrmesh, Triangles=False, FaceMerge=False)

filter = StreamFilter(Gate=lensselector, Stream0=item, Stream1=cap_2, Stream2=msh2psrf, Stream3=msh2psrf_2, Stream4=msh2psrf_3, Stream5=extr)
merge = Merge(Data1=filter, Data2=boxrec_2)  # -> flatten(Result)
sunion = SolidUnion(Breps=merge)
sdiff_2 = SolidDifference(BrepsA=sunion, BrepsB=move.Geometry)
sdiff_3 = SolidDifference(BrepsA=sdiff_2, BrepsB=cap)

# ----
# Mask
number_slider_5 = Slider(43, range=0..100)
number_slider_6 = Slider(100, range=0..1000)
dom = ConstructDomain(DomainStart=maskstart, DomainEnd=maskend)
pt_12 = Point(Point(45, 45, -50))
pt_13 = Point(Point(0, 0, -50))
rectangle_4 = Rectangle(Plane=pt_13, XSize=dom, YSize=Slider(90, range=0..100), Radius=0)  # -> Rectangle, Length
cyl_2 = Cylinder(Base=pt_12, Radius=number_slider_5, Length=number_slider_6)
boxrec_3 = BoxRectangle(Rectangle=rectangle_4.Rectangle, Height=number_slider_6)
cap_3 = CapHoles(Brep=cyl_2)
rotate = Rotate(Geometry=boxrec_3, Angle=degrees(maskangle), Plane=PlaneXY(45, 45, 0))  # -> Geometry, Transform
sint = SolidIntersection(BrepsA=cap_3, BrepsB=rotate.Geometry)
sint_2 = SolidIntersection(BrepsA=sdiff_3, BrepsB=sint)
sdiff_4 = SolidDifference(BrepsA=sdiff_3, BrepsB=cap_3)
sdiff_5 = SolidDifference(BrepsA=sdiff_3, BrepsB=sint)
sunion_2 = SolidUnion(Breps=[sint_2, sdiff_4])

list_2 = ValueList({"No Mask": 0, "PosiMask": 1, "NegaMask": 2}, selected="No Mask")
mask = GetNumber(list_2, AtLeast=1, AtMost=1, Maximum=1.797693135e+308, Minimum=-1.797693135e+308, Prompt="mask", TreeAccess=False)
filter_2 = StreamFilter(Gate=mask, Stream0=sdiff_3, Stream1=sdiff_5, Stream2=sunion_2)
brep = Brep(filter_2)
c_script = CSharpScript(mesh=brep)  # -> base64Draco; inputs mesh: Mesh
# ---------- c_script: C# ----------
    var options = new Rhino.FileIO.DracoCompressionOptions();
    options.CompressionLevel = 5;
    options.IncludeTextureCoordinates = false;
    options.IncludeVertexColors = false;

    var compressed = Rhino.FileIO.DracoCompression.Compress(mesh, options);
    base64Draco = compressed.ToBase64String();
# ---------- end c_script ----------
context_bake = ContextBake(MeshGeometry=brep)
context_print = ContextPrint(B64Mesh=c_script)
