# Grasshopper definition filterworkdesignerforui.gh (Grasshopper 1.0.8)
# plug-ins: Pufferfish, NGon_RH8

prism_level = Slider(100, range=0..100)
prismlevel = GetNumber(prism_level, AtLeast=1, AtMost=1, Maximum=1.797693135e+308, Minimum=-1.797693135e+308, TreeAccess=False)

# ----
# UI
ngonalprism_level = Slider(20, range=3..20)
lens_thickness = Slider(25, range=0..30)
triprism_level = Slider(10, range=10..28)
quadprism_level = Slider(200, range=200..400)
base_height = Slider(0.6, range=0..2)
mask_angle = Slider(0, range=0..360)
mask_start = Slider(0, range=0..100)
mask_end = Slider(45, range=0..88)
hole_size = Slider(0, range=0..100)
halo_level = Slider(5, range=0..20)

cross_density = Slider(38, range=0..100)
text_size = Slider(10, range=0..100)

crossstring = GetString("", AtLeast=1, AtMost=1, TreeAccess=False)
maskstart = GetNumber(mask_start, AtLeast=1, AtMost=1, Maximum=1.797693135e+308, Minimum=-1.797693135e+308, TreeAccess=False)
lensthickness = GetNumber(lens_thickness, AtLeast=1, AtMost=1, Maximum=1.797693135e+308, Minimum=-1.797693135e+308, TreeAccess=False)
holesize = GetNumber(hole_size, AtLeast=1, AtMost=1, Maximum=1.797693135e+308, Minimum=-1.797693135e+308, TreeAccess=False)
maskend = GetNumber(mask_end, AtLeast=1, AtMost=1, Maximum=1.797693135e+308, Minimum=-1.797693135e+308, TreeAccess=False)
maskangle = GetNumber(mask_angle, AtLeast=1, AtMost=1, Maximum=1.797693135e+308, Minimum=-1.797693135e+308, TreeAccess=False)
halolevel = GetNumber(halo_level, AtLeast=1, AtMost=1, Maximum=1.797693135e+308, Minimum=-1.797693135e+308, TreeAccess=False)
textsize = GetNumber(text_size, AtLeast=1, AtMost=1, Maximum=1.797693135e+308, Minimum=-1.797693135e+308, TreeAccess=False)
crossdensity = GetNumber(cross_density, AtLeast=1, AtMost=1, Maximum=1.797693135e+308, Minimum=-1.797693135e+308, TreeAccess=False)
number_slider = Slider(20, range=0..20)
quadprismlevel = GetNumber(quadprism_level, AtLeast=1, AtMost=1, Maximum=1.797693135e+308, Minimum=-1.797693135e+308, TreeAccess=False)
baseheight = GetNumber(base_height, AtLeast=1, AtMost=1, Maximum=1.797693135e+308, Minimum=-1.797693135e+308, TreeAccess=False)
triprismlevel = GetNumber(triprism_level, AtLeast=1, AtMost=1, Maximum=1.797693135e+308, Minimum=-1.797693135e+308, TreeAccess=False)
ngonalprismlevel = GetNumber(ngonalprism_level, AtLeast=1, AtMost=1, Maximum=1.797693135e+308, Minimum=-1.797693135e+308, TreeAccess=False)

# ----
# Plates
number_slider_2 = Slider(90, range=0..100)
rectangle = Rectangle(Plane=PlaneXY(0, 0, 20), XSize=number_slider_2, YSize=number_slider_2, Radius=0)  # -> Rectangle, Length
rectangle_2 = Rectangle(Plane=PlaneXY(0, 0, 0), XSize=number_slider_2, YSize=number_slider_2, Radius=0)  # -> Rectangle, Length
cyl = Cylinder(Base=PlaneXY(45, 45, -1), Radius=holesize, Length=20)
boxrec = BoxRectangle(Rectangle=rectangle.Rectangle, Height=Domain(0, 40))
cap = CapHoles(Brep=cyl)
boxrec_2 = BoxRectangle(Rectangle=rectangle_2.Rectangle, Height=baseheight)
neg = Negative(Value=halolevel)
Z = UnitZ(Factor=neg)
move = Move(Geometry=boxrec, Motion=Z)  # -> Geometry, Transform

# ----
# Cross
debrep = DeconstructBrep(Brep=rectangle_2.Rectangle)  # -> Faces, Edges, Vertices; disabled
item = ListItem(List=debrep.Edges, Index=1, Wrap=True)  # disabled
item_2 = ListItem(List=debrep.Edges, Index=2, Wrap=True)  # disabled
item_3 = ListItem(List=debrep.Edges, Index=3, Wrap=True)  # disabled
item_4 = ListItem(List=debrep.Edges, Index=4, Wrap=True)  # disabled
divide = DivideCurve(Curve=item, Count=crossdensity, Kinks=False)  # -> Points, Tangents, Parameters; disabled
divide_2 = DivideCurve(Curve=item_2, Count=crossdensity, Kinks=False)  # -> Points, Tangents, Parameters; disabled
divide_3 = DivideCurve(Curve=item_3, Count=crossdensity, Kinks=False)  # -> Points, Tangents, Parameters; disabled
divide_4 = DivideCurve(Curve=item_4, Count=crossdensity, Kinks=False)  # -> Points, Tangents, Parameters; disabled
rev = ReverseList(List=divide_3.Points)  # disabled
rev_2 = ReverseList(List=divide_4.Points)  # disabled
ln = Line(StartPoint=divide.Points, EndPoint=rev)  # disabled
ln_2 = Line(StartPoint=divide_2.Points, EndPoint=rev_2)  # disabled
pframes = PerpFrames(Curve=ln, Count=2, Align=True)  # -> Frames, Parameters; disabled
pframes_2 = PerpFrames(Curve=ln_2, Count=2, Align=True)  # -> Frames, Parameters; disabled
number_slider_3 = Slider(0.1, range=0..0.1)  # disabled
polygon = Polygon(Plane=pframes_2.Frames, Radius=number_slider_3, Segments=4, FilletRadius=0)  # -> Polygon, Length; disabled
polygon_2 = Polygon(Plane=pframes.Frames, Radius=number_slider_3, Segments=4, FilletRadius=0)  # -> Polygon, Length; disabled
rotate = Rotate(Geometry=polygon.Polygon, Angle=degrees(45), Plane=pframes_2.Frames)  # -> Geometry, Transform; disabled
rotate_2 = Rotate(Geometry=polygon_2.Polygon, Angle=degrees(45), Plane=pframes.Frames)  # -> Geometry, Transform; disabled
loft = Loft(Curves=rotate.Geometry, Options={Adjust=False, Closed=False, LoftEnds=0, LoftSimp=0, LoftType=0, Rebuild=10, Refit=0.01})  # disabled
loft_2 = Loft(
    Curves=rotate_2.Geometry,
    Options={Adjust=False, Closed=False, LoftEnds=0, LoftSimp=0, LoftType=0, Rebuild=10, Refit=0.01})  # disabled
cap_2 = CapHoles(Brep=[loft_2, loft])  # disabled
sunion = SolidUnion(Breps=flatten(cap_2))  # disabled

# ----
# Convex
number_slider_4 = Slider(45, range=0..100)
pt = ConstructPoint(XCoordinate=88, YCoordinate=number_slider_4, ZCoordinate=baseheight)
pt_2 = ConstructPoint(XCoordinate=2, YCoordinate=number_slider_4, ZCoordinate=baseheight)
pt_3 = ConstructPoint(XCoordinate=number_slider_4, YCoordinate=number_slider_4, ZCoordinate=lensthickness)
pt_4 = ConstructPoint(XCoordinate=number_slider_4, YCoordinate=88, ZCoordinate=baseheight)
pt_5 = Point(pt)
pt_6 = Point(pt_4)
pt_7 = Point(pt_2)
pt_8 = Point(pt_3)
sph4pt = Sphere4Pt(Point1=pt_5, Point2=pt_6, Point3=pt_7, Point4=pt_8)  # -> Center, Radius, Sphere
sdiff = SolidDifference(BrepsA=sph4pt.Sphere, BrepsB=boxrec_2)
item_5 = ListItem(List=sdiff, Index=0, Wrap=True)

# ----
# Prism
pt_9 = ConstructPoint(XCoordinate=number_slider_4, YCoordinate=number_slider_4, ZCoordinate=baseheight)
pt_10 = Point(pt_9)
cone = Cone(Base=pt_10, Radius=Slider(43, range=0..100), Length=lensthickness)  # -> Cone, Tip
cap_3 = CapHoles(Brep=cone.Cone)

list = ValueList({"Convex": 0, "Prism": 1, "TriPrism": 2, "HexaPrism": 3, "QuadPrism": 4, "NgonalPrism": 5}, selected="Convex")
lensselector = GetString(list, AtLeast=1, AtMost=1, TreeAccess=False)
gate = StreamGate(Stream=prismlevel, Gate=lensselector)  # -> Target0, Target1, Target2, Target3, Target4, Target5

# ----
# NgonalPrism
panel = Panel("20")
dom = ConstructDomain(DomainStart="3", DomainEnd=panel)
remap = RemapNumbers(Value=gate.Target5, Source=Domain(0, 100), Target=dom)  # -> Mapped, Clipped
pt_11 = Point(Point(45, 45, 0.6))
cir = Circle(Plane=pt_11, Radius=Slider(43, range=0..100))
divide_5 = DivideCurve(Curve=cir, Count=remap.Mapped, Kinks=False)  # -> Points, Tangents, Parameters
pline = PolyLine(Vertices=divide_5.Points, Closed=True)
boundary = BoundarySurfaces(Edges=pline)
extr = ExtrudePoint(Base=boundary, Point=pt_3)

gate_2 = StreamGate(Stream=item_5, Gate=lensselector)  # -> Target0, Target1, Target2, Target3, Target4, Target5

# ----
# QuadPrism
panel_2 = Panel("200")
dom_2 = ConstructDomain(DomainStart=panel_2, DomainEnd="400")
remap_2 = RemapNumbers(Value=gate.Target4, Source=Domain(0, 100), Target=dom_2)  # -> Mapped, Clipped
qrsettings = QuadRemeshSettings(TargetCount=remap_2.Mapped, AdaptiveSize=0, AdaptiveCount=False, HardEdges=True, SeamEdges=1, Symmetry=0, GuideCurves=0)
qrmesh = QuadRemesh(Geometry=gate_2.Target4, Settings=qrsettings)
msh2psrf = MeshToPolysurface(Mesh=qrmesh, Triangles=False, FaceMerge=False)

# ----
# TriPrism/HexaPrism
relay = Relay([gate.Target2, gate.Target3])
dom_3 = ConstructDomain(DomainStart="10", DomainEnd="28")
remap_3 = RemapNumbers(Value=relay, Source=Domain(0, 100), Target=dom_3)  # -> Mapped, Clipped
triremesh = TriRemesh(Geometry=[gate_2.Target2, gate_2.Target3], Length=remap_3.Mapped, Iterations=100)  # -> Triangulation, Dual, Creases
msh2psrf_2 = MeshToPolysurface(Mesh=triremesh.Triangulation, Triangles=False, FaceMerge=False)
msh2psrf_3 = MeshToPolysurface(Mesh=triremesh.Dual, Triangles=False, FaceMerge=False)

filter = StreamFilter(Gate=lensselector, Stream0=item_5, Stream1=cap_3, Stream2=msh2psrf_2, Stream3=msh2psrf_3, Stream4=msh2psrf, Stream5=extr)
merge = Merge(Data1=filter, Data2=boxrec_2)
sunion_2 = SolidUnion(Breps=flatten(merge))
sdiff_2 = SolidDifference(BrepsA=sunion_2, BrepsB=move.Geometry)
bbox = BoundingBox(Content=sdiff_2, Plane=PlaneXY(0, 0, 0))  # -> Box, Box_2
debox = DeconstructBox(Box=bbox.Box)  # -> Plane, X, Y, Z
dedomain = DeconstructDomain(Domain=debox.Z)  # -> Start, End

# ----
# Text
addition = Addition(A=dedomain.End, B=2)
pt_12 = ConstructPoint(XCoordinate=0, YCoordinate=0, ZCoordinate=addition)
pt_13 = Point(pt_12)
text = Text(Location=PlaneXY(45, 45, 0), Text=crossstring, Size=textsize, Bold=True, HorizontalAlignment=0, VerticalAlignment=0)
yz = YZPlane(Origin=Point(45, 45, 0))
mirror = Mirror(Geometry=text, Plane=yz)  # -> Geometry, Transform
boundary_2 = BoundarySurfaces(Edges=mirror.Geometry)
extr_2 = Extrude(Base=boundary_2, Direction=pt_13)  # -> flatten(Extrusion)

sunion_3 = SolidUnion(Breps=[extr_2, sdiff_2])
sdiff_3 = SolidDifference(BrepsA=sunion_3, BrepsB=cap)

# ----
# Mask
number_slider_5 = Slider(43, range=0..100)
number_slider_6 = Slider(100, range=0..1000)
dom_4 = ConstructDomain(DomainStart=maskstart, DomainEnd=maskend)
pt_14 = Point(Point(45, 45, -50))
pt_15 = Point(Point(0, 0, -50))
rectangle_3 = Rectangle(Plane=pt_15, XSize=dom_4, YSize=Slider(90, range=0..100), Radius=0)  # -> Rectangle, Length
cyl_2 = Cylinder(Base=pt_14, Radius=number_slider_5, Length=number_slider_6)
boxrec_3 = BoxRectangle(Rectangle=rectangle_3.Rectangle, Height=number_slider_6)
cap_4 = CapHoles(Brep=cyl_2)
sdiff_4 = SolidDifference(BrepsA=sdiff_3, BrepsB=cap_4)
rotate_3 = Rotate(Geometry=boxrec_3, Angle=degrees(maskangle), Plane=PlaneXY(45, 45, 0))  # -> Geometry, Transform
sint = SolidIntersection(BrepsA=cap_4, BrepsB=rotate_3.Geometry)
sint_2 = SolidIntersection(BrepsA=sdiff_3, BrepsB=sint)
sdiff_5 = SolidDifference(BrepsA=sdiff_3, BrepsB=sint)
sunion_4 = SolidUnion(Breps=[sint_2, sdiff_4])

list_2 = ValueList({"No Mask": 0, "PosiMask": 1, "NegaMask": 2}, selected="No Mask")
mask = GetNumber(list_2, AtLeast=1, AtMost=1, Maximum=1.797693135e+308, Minimum=-1.797693135e+308, Prompt="mask", TreeAccess=False)
filter_2 = StreamFilter(Gate=mask, Stream0=sdiff_3, Stream1=sdiff_5, Stream2=sunion_4)
brep = Brep(filter_2)
sdiff_6 = SolidDifference(BrepsA=brep, BrepsB=sunion)
list_3 = ValueList({"No Cross": 0, "Cross": 1}, selected="No Cross")
cross = GetNumber(list_3, AtLeast=1, AtMost=1, Maximum=1.797693135e+308, Minimum=-1.797693135e+308, Prompt="mask", TreeAccess=False)
filter_3 = StreamFilter(Gate=cross, Stream0=brep, Stream1=sdiff_6)
brep_2 = Brep(filter_3)
c_script = CSharpScript(mesh=filter_3)  # -> base64Draco; inputs mesh: Mesh
# ---------- c_script: C# ----------
    var options = new Rhino.FileIO.DracoCompressionOptions();
    options.CompressionLevel = 5;
    options.IncludeTextureCoordinates = false;
    options.IncludeVertexColors = false;

    var compressed = Rhino.FileIO.DracoCompression.Compress(mesh, options);
    base64Draco = compressed.ToBase64String();
# ---------- end c_script ----------
context_bake = ContextBake(MeshGeometry=filter_3)
context_print = ContextPrint(B64Mesh=c_script)
