# Grasshopper definition filterworkdesignerforui_vray.gh (Grasshopper 1.0.8)
# plug-ins: Pufferfish, V-Ray For Grasshopper 8, LunchBox, MetaHopper, Axolotl Info, NGon_RH8

path = FilePath("C:\Users\spz26\Desktop\lensfilter\lensfilter_GUI\fwd_ui\filterwork.csv")
file = ReadFile(File=path, PerLineParse=True)
csv = ReadCSV(CSVString=file, Delimiter=",", DataStruct=False)  # -> Headers, Values
item = ListItem(List=csv.Values, Index=0, Wrap=True)  # -> Item, Item1, Item2, Item3, Item4, Item5, Item6, Item7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
panel = Panel(csv.Values)

prism_level = Slider(100, range=0..100)
prismlevel = GetNumber(item.Item4, AtLeast=1, AtMost=1, Maximum=1.797693135e+308, Minimum=-1.797693135e+308, TreeAccess=False)

# ----
# UI
ngonalprism_level = Slider(20, range=3..20)
lens_thickness = Slider(10, range=0..30)
triprism_level = Slider(10, range=10..28)
quadprism_level = Slider(200, range=200..400)
base_height = Slider(0.6, range=0..2)
mask_start = Slider(20, range=0..100)
mask_angle = Slider(0, range=0..360)
hole_size = Slider(0, range=0..100)
mask_end = Slider(45, range=0..88)
halo_level = Slider(10, range=0..20)

cross_density = Slider(15, range=0..100)
text_size = Slider(0, range=0..100)

ellipse = Ellipse(Plane=PlaneXY(0, 0, 0), Radius1=1, Radius2=1)  # -> Ellipse, Focus1, Focus2
maskstart = GetNumber(item.Item5, AtLeast=1, AtMost=1, Maximum=1.797693135e+308, Minimum=-1.797693135e+308, TreeAccess=False)
maskend = GetNumber(item.Item6, AtLeast=1, AtMost=1, Maximum=1.797693135e+308, Minimum=-1.797693135e+308, TreeAccess=False)
maskangle = GetNumber(item.Item7, AtLeast=1, AtMost=1, Maximum=1.797693135e+308, Minimum=-1.797693135e+308, TreeAccess=False)
holesize = GetNumber(item.Item8, AtLeast=1, AtMost=1, Maximum=1.797693135e+308, Minimum=-1.797693135e+308, TreeAccess=False)
get_string = GetString(item.Item9, AtLeast=1, AtMost=1, TreeAccess=False)
textsize = GetNumber(item.Item10, AtLeast=1, AtMost=1, Maximum=1.797693135e+308, Minimum=-1.797693135e+308, TreeAccess=False)
lensthickness = GetNumber(item.Item, AtLeast=1, AtMost=1, Maximum=1.797693135e+308, Minimum=-1.797693135e+308, TreeAccess=False)
baseheight = GetNumber(item.Item1, AtLeast=1, AtMost=1, Maximum=1.797693135e+308, Minimum=-1.797693135e+308, TreeAccess=False)
halolevel = GetNumber(item.Item2, AtLeast=1, AtMost=1, Maximum=1.797693135e+308, Minimum=-1.797693135e+308, TreeAccess=False)
triprismlevel = GetNumber(triprism_level, AtLeast=1, AtMost=1, Maximum=1.797693135e+308, Minimum=-1.797693135e+308, TreeAccess=False)
quadprismlevel = GetNumber(quadprism_level, AtLeast=1, AtMost=1, Maximum=1.797693135e+308, Minimum=-1.797693135e+308, TreeAccess=False)
ngonalprismlevel = GetNumber(ngonalprism_level, AtLeast=1, AtMost=1, Maximum=1.797693135e+308, Minimum=-1.797693135e+308, TreeAccess=False)
crossdensity = GetNumber(item.Item11, AtLeast=1, AtMost=1, Maximum=1.797693135e+308, Minimum=-1.797693135e+308, TreeAccess=False)

# ----
# Plates
number_slider = Slider(90, range=0..100)
rectangle = Rectangle(Plane=PlaneXY(0, 0, 20), XSize=number_slider, YSize=number_slider, Radius=0)  # -> Rectangle, Length
rectangle_2 = Rectangle(Plane=PlaneXY(0, 0, 0), XSize=number_slider, YSize=number_slider, Radius=0)  # -> Rectangle, Length
cyl = Cylinder(Base=PlaneXY(45, 45, -1), Radius=holesize, Length=20)
boxrec = BoxRectangle(Rectangle=rectangle.Rectangle, Height=Domain(0, 40))
cap = CapHoles(Brep=cyl)
boxrec_2 = BoxRectangle(Rectangle=rectangle_2.Rectangle, Height=baseheight)
neg = Negative(Value=halolevel)
Z = UnitZ(Factor=neg)
move = Move(Geometry=boxrec, Motion=Z)  # -> Geometry, Transform

# ----
# Cross
debrep = DeconstructBrep(Brep=rectangle_2.Rectangle)  # -> Faces, Edges, Vertices; disabled
item_2 = ListItem(List=debrep.Edges, Index=1, Wrap=True)  # disabled
item_3 = ListItem(List=debrep.Edges, Index=2, Wrap=True)  # disabled
item_4 = ListItem(List=debrep.Edges, Index=3, Wrap=True)  # disabled
item_5 = ListItem(List=debrep.Edges, Index=4, Wrap=True)  # disabled
divide = DivideCurve(Curve=item_2, Count=crossdensity, Kinks=False)  # -> Points, Tangents, Parameters; disabled
divide_2 = DivideCurve(Curve=item_3, Count=crossdensity, Kinks=False)  # -> Points, Tangents, Parameters; disabled
divide_3 = DivideCurve(Curve=item_4, Count=crossdensity, Kinks=False)  # -> Points, Tangents, Parameters; disabled
divide_4 = DivideCurve(Curve=item_5, Count=crossdensity, Kinks=False)  # -> Points, Tangents, Parameters; disabled
rev = ReverseList(List=divide_3.Points)  # disabled
rev_2 = ReverseList(List=divide_4.Points)  # disabled
ln = Line(StartPoint=divide.Points, EndPoint=rev)  # disabled
ln_2 = Line(StartPoint=divide_2.Points, EndPoint=rev_2)  # disabled
pframes = PerpFrames(Curve=ln, Count=2, Align=True)  # -> Frames, Parameters; disabled
number_slider_2 = Slider(0.1, range=0..0.1)  # disabled
pframes_2 = PerpFrames(Curve=ln_2, Count=2, Align=True)  # -> Frames, Parameters; disabled
polygon = Polygon(Plane=pframes_2.Frames, Radius=number_slider_2, Segments=4, FilletRadius=0)  # -> Polygon, Length; disabled
polygon_2 = Polygon(Plane=pframes.Frames, Radius=number_slider_2, Segments=4, FilletRadius=0)  # -> Polygon, Length; disabled
rotate = Rotate(Geometry=polygon.Polygon, Angle=degrees(45), Plane=pframes_2.Frames)  # -> Geometry, Transform; disabled
rotate_2 = Rotate(Geometry=polygon_2.Polygon, Angle=degrees(45), Plane=pframes.Frames)  # -> Geometry, Transform; disabled
loft = Loft(Curves=rotate.Geometry, Options={Adjust=False, Closed=False, LoftEnds=0, LoftSimp=0, LoftType=0, Rebuild=10, Refit=0.01})  # disabled
loft_2 = Loft(
    Curves=rotate_2.Geometry,
    Options={Adjust=False, Closed=False, LoftEnds=0, LoftSimp=0, LoftType=0, Rebuild=10, Refit=0.01})  # disabled
cap_2 = CapHoles(Brep=[loft_2, loft])  # disabled
sunion = SolidUnion(Breps=flatten(cap_2))  # disabled

# ----
# Convex
number_slider_3 = Slider(45, range=0..100)
pt = ConstructPoint(XCoordinate=88, YCoordinate=number_slider_3, ZCoordinate=baseheight)
pt_2 = ConstructPoint(XCoordinate=2, YCoordinate=number_slider_3, ZCoordinate=baseheight)
pt_3 = ConstructPoint(XCoordinate=number_slider_3, YCoordinate=number_slider_3, ZCoordinate=lensthickness)
pt_4 = ConstructPoint(XCoordinate=number_slider_3, YCoordinate=88, ZCoordinate=baseheight)
pt_5 = Point(pt)
pt_6 = Point(pt_4)
pt_7 = Point(pt_2)
pt_8 = Point(pt_3)
sph4pt = Sphere4Pt(Point1=pt_5, Point2=pt_6, Point3=pt_7, Point4=pt_8)  # -> Center, Radius, Sphere
sdiff = SolidDifference(BrepsA=sph4pt.Sphere, BrepsB=boxrec_2)
item_6 = ListItem(List=sdiff, Index=0, Wrap=True)

# ----
# Prism
pt_9 = ConstructPoint(XCoordinate=number_slider_3, YCoordinate=number_slider_3, ZCoordinate=baseheight)
pt_10 = Point(pt_9)
cone = Cone(Base=pt_10, Radius=Slider(43, range=0..100), Length=lensthickness)  # -> Cone, Tip
cap_3 = CapHoles(Brep=cone.Cone)

boolean_subtract = BooleanSubtract()
pt_11 = Point(Point(0, 1, 0))
pt_12 = Point(Point(1, 0, 0))
move_2 = Move(Geometry=ln, Motion=pt_11)  # -> Geometry, Transform
move_3 = Move(Geometry=ln_2, Motion=pt_12)  # -> Geometry, Transform
end = EndPoints(Curve=ln)  # -> Start, End
end_2 = EndPoints(Curve=move_2.Geometry)  # -> Start, End
end_3 = EndPoints(Curve=ln_2)  # -> Start, End
end_4 = EndPoints(Curve=move_3.Geometry)  # -> Start, End
ln_3 = Line(StartPoint=end.Start, EndPoint=end_2.Start)
ln_4 = Line(StartPoint=end.End, EndPoint=end_2.End)
ln_5 = Line(StartPoint=end_3.Start, EndPoint=end_4.Start)
ln_6 = Line(StartPoint=end_3.End, EndPoint=end_4.End)
join = JoinCurves(Curves=[ln_2, ln_5, move_3.Geometry, ln_6], Preserve=False)
join_2 = JoinCurves(Curves=[ln_3, move_2.Geometry, ln_4, ln], Preserve=False)
boundary = BoundarySurfaces(Edges=join_2)
join_3 = JoinCurves(Curves=[join_2, join], Preserve=False)
join_4 = BrepJoin(Breps=boundary)  # -> Breps, Closed
pt_13 = Point(Point(0, 0, 0.05))
extr = Extrude(Base=join_3, Direction=pt_13)
join_5 = BrepJoin(Breps=extr)  # -> Breps, Closed
list = ValueList({"Convex": 0, "Prism": 1, "TriPrism": 2, "HexaPrism": 3, "QuadPrism": 4, "NgonalPrism": 5}, selected="NgonalPrism")
merge = Merge(
    Data1=lens_thickness,
    Data2=base_height,
    Data3=halo_level,
    Data4=list,
    Data5=prism_level,
    Data6=mask_start,
    Data7=mask_end,
    Data8=mask_angle,
    Data9=hole_size,
    Data10="UIST",
    Data11=text_size,
    Data12=cross_density)
csv_2 = CreateCSV(DataGridHeaders="Lens Parameters", ValueTree=simplify(merge), Delimiter=",", QuoteItems=False, DataStruct=False)
excelwrite = ExcelWriter(
    WriteExcelData=False,
    WorksheetName="Sheet1",
    ColumnHeadings="Lens Parameters",
    Data=csv_2,
    ClearSheet=False,
    DataStruct=False)
panel_2 = Panel(csv_2)
lensselector = GetString(item.Item3, AtLeast=1, AtMost=1, TreeAccess=False)
gate = StreamGate(Stream=prismlevel, Gate=lensselector)  # -> Target0, Target1, Target2, Target3, Target4, Target5

# ----
# NgonalPrism
panel_3 = Panel("20")
dom = ConstructDomain(DomainStart="3", DomainEnd=panel_3)
remap = RemapNumbers(Value=gate.Target5, Source=Domain(0, 100), Target=dom)  # -> Mapped, Clipped
pt_14 = Point(Point(45, 45, 0.6))
cir = Circle(Plane=pt_14, Radius=Slider(43, range=0..100))
divide_5 = DivideCurve(Curve=cir, Count=remap.Mapped, Kinks=False)  # -> Points, Tangents, Parameters
pline = PolyLine(Vertices=divide_5.Points, Closed=True)
boundary_2 = BoundarySurfaces(Edges=pline)
extr_2 = ExtrudePoint(Base=boundary_2, Point=pt_3)

gate_2 = StreamGate(Stream=item_6, Gate=lensselector)  # -> Target0, Target1, Target2, Target3, Target4, Target5

# ----
# QuadPrism
panel_4 = Panel("200")
dom_2 = ConstructDomain(DomainStart=panel_4, DomainEnd="400")
remap_2 = RemapNumbers(Value=gate.Target4, Source=Domain(0, 100), Target=dom_2)  # -> Mapped, Clipped
qrsettings = QuadRemeshSettings(TargetCount=remap_2.Mapped, AdaptiveSize=0, AdaptiveCount=False, HardEdges=True, SeamEdges=1, Symmetry=0, GuideCurves=0)
qrmesh = QuadRemesh(Geometry=gate_2.Target4, Settings=qrsettings)
msh2psrf = MeshToPolysurface(Mesh=qrmesh, Triangles=False, FaceMerge=False)

# ----
# TriPrism/HexaPrism
relay = Relay([gate.Target2, gate.Target3])
dom_3 = ConstructDomain(DomainStart="10", DomainEnd="28")
remap_3 = RemapNumbers(Value=relay, Source=Domain(0, 100), Target=dom_3)  # -> Mapped, Clipped
triremesh = TriRemesh(Geometry=[gate_2.Target2, gate_2.Target3], Length=remap_3.Mapped, Iterations=100)  # -> Triangulation, Dual, Creases
msh2psrf_2 = MeshToPolysurface(Mesh=triremesh.Triangulation, Triangles=False, FaceMerge=False)
msh2psrf_3 = MeshToPolysurface(Mesh=triremesh.Dual, Triangles=False, FaceMerge=False)

filter = StreamFilter(
    Gate=lensselector,
    Stream0=item_6,
    Stream1=cap_3,
    Stream2=msh2psrf_2,
    Stream3=msh2psrf_3,
    Stream4=msh2psrf,
    Stream5=extr_2)
merge_2 = Merge(Data1=filter, Data2=boxrec_2)
sunion_2 = SolidUnion(Breps=flatten(merge_2))
sdiff_2 = SolidDifference(BrepsA=sunion_2, BrepsB=move.Geometry)
bbox = BoundingBox(Content=sdiff_2, Plane=PlaneXY(0, 0, 0))  # -> Box, Box_2
debox = DeconstructBox(Box=bbox.Box)  # -> Plane, X, Y, Z
dedomain = DeconstructDomain(Domain=debox.Z)  # -> Start, End

# ----
# Text
addition = Addition(A=dedomain.End, B=2)
pt_15 = ConstructPoint(XCoordinate=0, YCoordinate=0, ZCoordinate=addition)
pt_16 = Point(pt_15)
text = Text(Location=PlaneXY(45, 45, 0), Text=get_string, Size=textsize, Bold=True, HorizontalAlignment=0, VerticalAlignment=0)
yz = YZPlane(Origin=Point(45, 45, 0))
mirror = Mirror(Geometry=text, Plane=yz)  # -> Geometry, Transform
boundary_3 = BoundarySurfaces(Edges=mirror.Geometry)
extr_3 = Extrude(Base=boundary_3, Direction=pt_16)  # -> flatten(Extrusion)

sunion_3 = SolidUnion(Breps=[extr_3, sdiff_2])
sdiff_3 = SolidDifference(BrepsA=sunion_3, BrepsB=cap)

# ----
# Mask
number_slider_4 = Slider(43, range=0..100)
number_slider_5 = Slider(100, range=0..1000)
dom_4 = ConstructDomain(DomainStart=maskstart, DomainEnd=maskend)
pt_17 = Point(Point(45, 45, -50))
pt_18 = Point(Point(0, 0, -50))
rectangle_3 = Rectangle(Plane=pt_18, XSize=dom_4, YSize=Slider(90, range=0..100), Radius=0)  # -> Rectangle, Length
cyl_2 = Cylinder(Base=pt_17, Radius=number_slider_4, Length=number_slider_5)
boxrec_3 = BoxRectangle(Rectangle=rectangle_3.Rectangle, Height=number_slider_5)
cap_4 = CapHoles(Brep=cyl_2)
sdiff_4 = SolidDifference(BrepsA=sdiff_3, BrepsB=cap_4)
rotate_3 = Rotate(Geometry=boxrec_3, Angle=degrees(maskangle), Plane=PlaneXY(45, 45, 0))  # -> Geometry, Transform
sint = SolidIntersection(BrepsA=cap_4, BrepsB=rotate_3.Geometry)
sint_2 = SolidIntersection(BrepsA=sdiff_3, BrepsB=sint)
sdiff_5 = SolidDifference(BrepsA=sdiff_3, BrepsB=sint)
sunion_4 = SolidUnion(Breps=[sint_2, sdiff_4])

list_2 = ValueList({"No Mask": 0, "PosiMask": 1, "NegaMask": 2}, selected="PosiMask")
number_slider_6 = Slider(1, range=0..1)
mask = GetNumber(list_2, AtLeast=1, AtMost=1, Maximum=1.797693135e+308, Minimum=-1.797693135e+308, Prompt="mask", TreeAccess=False)
filter_2 = StreamFilter(Gate=mask, Stream0=sdiff_3, Stream1=sdiff_5, Stream2=sunion_4)
brep = Brep(filter_2)
debrep_2 = DeconstructBrep(Brep=brep)  # -> Faces, Edges, Vertices
item_7 = ListItem(List=debrep_2.Faces, Index=Slider(4, range=0..10), Wrap=True)
project = ProjectCurve(Curve=join_2, Brep=item_7, Direction=Vector(0, 0, 1))
sdiff_6 = SolidDifference(BrepsA=brep, BrepsB=sunion)
list_3 = ValueList({"No Cross": 0, "Cross": 1}, selected="No Cross")
cross = GetNumber(list_3, AtLeast=1, AtMost=1, Maximum=1.797693135e+308, Minimum=-1.797693135e+308, Prompt="mask", TreeAccess=False)
filter_3 = StreamFilter(Gate=cross, Stream0=brep, Stream1=sdiff_6)
filter_4 = StreamFilter(Gate=list_3, Stream0=Toggle(False), Stream1=Toggle(True))
panel_5 = Panel(filter_4)
brep_2 = Brep(filter_3)
onoff = EnableDisableObject(
    Enabled=filter_4,
    AllObjects_Object=[divide, debrep, item_2, item_3, item_4, item_5, divide_2, divide_3, divide_4, ln, rev, rev_2, ln_2, crossdensity, pframes, pframes_2, polygon, rotate, loft, polygon_2, rotate_2, loft_2, sunion, cap_2, number_slider_2])
c_script = CSharpScript(mesh=filter_3)  # -> base64Draco; inputs mesh: Mesh
# ---------- c_script: C# ----------
    var options = new Rhino.FileIO.DracoCompressionOptions();
    options.CompressionLevel = 5;
    options.IncludeTextureCoordinates = false;
    options.IncludeVertexColors = false;

    var compressed = Rhino.FileIO.DracoCompression.Compress(mesh, options);
    base64Draco = compressed.ToBase64String();
# ---------- end c_script ----------
context_print = ContextPrint(B64Mesh=c_script)
context_bake = ContextBake(MeshGeometry=filter_3)
yz_2 = YZPlane(Origin=Point(0, 0, 0))
number_slider_7 = Slider(100, range=0..100)
rotate_4 = Rotate(Geometry=brep_2, Angle=1.570796327, Plane=yz_2)  # -> Geometry, Transform
subtraction = Subtraction(A=Slider(0, range=0..10), B=Slider(15, range=0..100))
pt_19 = ConstructPoint(XCoordinate=number_slider_7, YCoordinate=number_slider_7, ZCoordinate=Slider(1621, range=0..10000))
rotate_5 = Rotate(Geometry=rotate_4.Geometry, Angle=degrees(Slider(225, range=0..1000)), Plane=PlaneXY(0, 0, 0))  # -> Geometry, Transform
neg_2 = Negative(Value=Slider(39, range=0..100))
pt_20 = ConstructPoint(XCoordinate=Slider(30, range=0..100), YCoordinate=subtraction, ZCoordinate=0)
mtl_file_path = VRayMaterialFromFile(
    "C:\Users\takeg\Desktop\filterwork\YoshimotoGlass.vrmat",
    File_Picker=0,
    File_Types="V-Ray materials (*.vrmat)|*.vrmat",
    Multiple_Files=True)
pt_21 = Point(Point(3000, -7500, 1521.899032))
pt_22 = Point(pt_20)
move_4 = Move(Geometry=rotate_5.Geometry, Motion=pt_21)  # -> Geometry, Transform
area = Area(Geometry=move_4.Geometry)  # -> Area, Centroid
panel_6 = Panel(area.Centroid)
move_5 = Move(Geometry=area.Centroid, Motion=pt_22)  # -> Geometry, Transform
proxy_scene = VRayProxyScene(
    FilePath="C:\Users\takeg\Desktop\filterwork\scenetest\Rhino_interior_day_HQ.vrscene",
    LightsOn=True,
    BasePlane=PlaneXY(0, 0, 0),
    Scale=10,
    Visible=True,
    PreviewType=0)
vgeo = VRayGeometry(Geo=move_4.Geometry, Material=mtl_file_path, Visible=True, quality=2)
pt_23 = Point(Point(2960, -7527, 1566))
camera = VRayCamera(
    Position=move_5.Geometry,
    Target=pt_23,
    FOV=Slider(73.7, range=0..100),
    Tilt=0,
    OrthographicZoomFactor=0,
    PhysicalExposureOn=True,
    WhiteBalance=RGB(255, 255, 255),
    FNumber=8,
    ShutterSpeed1S=50,
    FilmSensitivity=100,
    AutoExposure=1,
    AutoWhiteBalance=False,
    DepthOfFieldFocus=0)  # -> Camera, Angle, ExposureValue
entwine = Entwine(Branch00=vgeo, Branch01=proxy_scene, FlattenInputs=True)
engine = Engine(
    1,
    Has_Extract_Parameter=False,
    Has_Manage_Collection=False,
    OptionsLength=3,
    Version=1,
    Options=["CPU", "GPU CUDA", "GPU RTX (legacy)"])
panel_7 = Panel(camera.ExposureValue)
render = VRayRender(
    Engine=engine,
    Sampler=0,
    Quality=5,
    OutputResolution=[2000, 2000],
    Camera=camera.Camera,
    VGeometry=flatten(entwine),
    UpdateEffectsFrequency=100)
