# Grasshopper definition filterworkdesignerforui_vray.gh (Grasshopper 1.0.8)
# plug-ins: Pufferfish, V-Ray For Grasshopper 8, LunchBox, NGon_RH8

path = FilePath("C:\Users\spz26\Desktop\lensfilter\expressive_optics\test.csv")
file = ReadFile(File=path, PerLineParse=True)
csv = ReadCSV(CSVString=file, Delimiter=",", DataStruct=False)  # -> Headers, Values
panel = Panel(csv.Values)
item = ListItem(List=csv.Values, Index=0, Wrap=True)  # -> Item, Item1, Item2, Item3, Item4, Item5, Item6, Item7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
hole_type = Slider(4, range=0..20)

prism_level = Slider(30, range=0..100)
prismlevel = GetNumber(item.Item4, AtLeast=1, AtMost=1, Maximum=1.797693135e+308, Minimum=-1.797693135e+308, TreeAccess=False)

# ----
# UI
lens_thickness = Slider(5, range=0..30)
ngonalprism_level = Slider(20, range=3..20)
triprism_level = Slider(10, range=10..28)
quadprism_level = Slider(200, range=200..400)
base_height = Slider(0.6, range=0..2)
mask_start = Slider(0, range=0..100)
mask_angle = Slider(0, range=0..360)
hole_size = Slider(10, range=0..100)
mask_end = Slider(88, range=0..100)
halo_level = Slider(10, range=0..20)

cross_density = Slider(10, range=0..100)
text_size = Slider(0, range=0..100)

maskstart = GetNumber(item.Item5, AtLeast=1, AtMost=1, Maximum=1.797693135e+308, Minimum=-1.797693135e+308, TreeAccess=False)
maskend = GetNumber(item.Item6, AtLeast=1, AtMost=1, Maximum=1.797693135e+308, Minimum=-1.797693135e+308, TreeAccess=False)
maskangle = GetNumber(item.Item7, AtLeast=1, AtMost=1, Maximum=1.797693135e+308, Minimum=-1.797693135e+308, TreeAccess=False)
holesize = GetNumber(item.Item8, AtLeast=1, AtMost=1, Maximum=1.797693135e+308, Minimum=-1.797693135e+308, TreeAccess=False)
textsize = GetNumber(item.Item10, AtLeast=1, AtMost=1, Maximum=1.797693135e+308, Minimum=-1.797693135e+308, TreeAccess=False)
crossdensity = GetNumber(item.Item11, AtLeast=1, AtMost=1, Maximum=1.797693135e+308, Minimum=-1.797693135e+308, TreeAccess=False)
halolevel = GetNumber(item.Item2, AtLeast=1, AtMost=1, Maximum=1.797693135e+308, Minimum=-1.797693135e+308, TreeAccess=False)
triprismlevel = GetNumber(triprism_level, AtLeast=1, AtMost=1, Maximum=1.797693135e+308, Minimum=-1.797693135e+308, TreeAccess=False)
quadprismlevel = GetNumber(quadprism_level, AtLeast=1, AtMost=1, Maximum=1.797693135e+308, Minimum=-1.797693135e+308, TreeAccess=False)
ngonalprismlevel = GetNumber(ngonalprism_level, AtLeast=1, AtMost=1, Maximum=1.797693135e+308, Minimum=-1.797693135e+308, TreeAccess=False)
baseheight = GetNumber(item.Item1, AtLeast=1, AtMost=1, Maximum=1.797693135e+308, Minimum=-1.797693135e+308, TreeAccess=False)
crossstring = GetString(item.Item9, AtLeast=1, AtMost=1, TreeAccess=False)
lensthickness = GetNumber(item.Item, AtLeast=1, AtMost=1, Maximum=1.797693135e+308, Minimum=-1.797693135e+308, TreeAccess=False)
number_slider = Slider(28, range=0..100)
lens_distance = Slider(26, range=0..100)
filter_size = Slider(23.5, range=0..100)
number_slider_2 = Slider(0.2, range=0..1)
addition = Addition(A=45, B=filter_size)
subtraction = Subtraction(A=45, B=filter_size)
pt = ConstructPoint(XCoordinate=0, YCoordinate=number_slider_2, ZCoordinate=0)
pt_2 = ConstructPoint(XCoordinate=number_slider_2, YCoordinate=0, ZCoordinate=0)
number_slider_3 = Slider(0.1, range=0..0.1)
Z = UnitZ(Factor=Slider(0.5, range=0..0.8))
list = ValueList({"Convex": 0, "Prism": 1, "TriPrism": 2, "HexaPrism": 3, "QuadPrism": 4, "NgonalPrism": 5, "None": 6}, selected="None")
lensselector = GetString(item.Item3, AtLeast=1, AtMost=1, TreeAccess=False)
gate = StreamGate(Stream=prismlevel, Gate=lensselector)  # -> Target0, Target1, Target2, Target3, Target4, Target5
list_2 = ValueList({"No Cross": 0, "Cross": 1}, selected="Cross")
cross = GetNumber(item.Item13, AtLeast=1, AtMost=1, Maximum=1.797693135e+308, Minimum=-1.797693135e+308, Prompt="mask", TreeAccess=False)
number_slider_4 = Slider(1, range=0..1)
holetype = GetNumber(item.Item14, AtLeast=1, AtMost=1, Maximum=1.797693135e+308, Minimum=-1.797693135e+308, TreeAccess=False)
remap = RemapNumbers(Value=maskend, Source=Domain(0, 100), Target=Domain(0, 88))  # -> Mapped, Clipped
remap_2 = RemapNumbers(Value=maskstart, Source=Domain(0, 100), Target=Domain(0, 88))  # -> Mapped, Clipped
mask = GetNumber(item.Item12, AtLeast=1, AtMost=1, Maximum=1.797693135e+308, Minimum=-1.797693135e+308, Prompt="mask", TreeAccess=False)
list_3 = ValueList({"No Mask": 0, "PosiMask": 1, "NegaMask": 2}, selected="NegaMask")
merge = Merge(
    Data1=lens_thickness,
    Data2=base_height,
    Data3=halo_level,
    Data4=list,
    Data5=prism_level,
    Data6=mask_start,
    Data7=mask_end,
    Data8=mask_angle,
    Data9=hole_size,
    Data10="UIST",
    Data11=text_size,
    Data12=cross_density,
    Data13=list_3,
    Data14=list_2,
    Data15=hole_type)
csv_2 = CreateCSV(DataGridHeaders="Lens Parameters", ValueTree=simplify(merge), Delimiter=",", QuoteItems=False, DataStruct=False)
excelwrite = ExcelWriter(
    WriteExcelData=False,
    WorksheetName="Sheet1",
    ColumnHeadings="Lens Parameters",
    Data=csv_2,
    ClearSheet=False,
    DataStruct=False)
panel_2 = Panel(csv_2)
pt_3 = Point(Point(45, 45, -1))
polygon = Polygon(Plane=pt_3, Radius=holesize, Segments=holetype, FilletRadius=0)  # -> Polygon, Length
cyl = Cylinder(Base=PlaneXY(45, 45, -1), Radius=holesize, Length=20)
extr = Extrude(Base=polygon.Polygon, Direction=Vector(0, 0, 20))
cap = CapHoles(Brep=cyl)
larger = LargerThan(FirstNumber=holetype, SecondNumber=2)  # -> LargerThan, OrEqualTo
cap_2 = CapHoles(Brep=extr)
filter = StreamFilter(Gate=larger.LargerThan, Stream0=cap, Stream1=cap_2)
panel_3 = Panel(larger.LargerThan)
brep = Brep(filter)
yz = YZPlane(Origin=Point(0, 0, 0))
number_slider_5 = Slider(100, range=0..100)
number_slider_6 = Slider(1621, range=0..10000)
Z_2 = UnitZ(Factor=1)
Z_3 = UnitZ(Factor=1)
pt_4 = Point(Point(3000, -7500, 1521.899032))
subtraction_2 = Subtraction(A=0, B=lens_distance)
mtl_file_path = VRayMaterialFromFile(
    "C:\Users\takeg\Desktop\filterwork\YoshimotoGlass.vrmat",
    File_Picker=0,
    File_Types="V-Ray materials (*.vrmat)|*.vrmat",
    Multiple_Files=True)
pt_5 = ConstructPoint(XCoordinate=Slider(43, range=0..100), YCoordinate=Slider(45, range=0..100), ZCoordinate=subtraction_2)
file_path = FilePath(
    "C:\Users\takeg\Desktop\filterworkdesigner\test3.vrscene",
    File_Picker=0,
    File_Types="V-Ray Scene files (*.vrscene)|*.vrscene",
    Multiple_Files=False)
pt_6 = Point(pt_5)
number_slider_7 = Slider(0, range=0..100)
pt_7 = Point(Point(2960, -7520, 1566))
xy = XYPlane(Origin=pt_6)
proxy_scene = VRayProxyScene(FilePath=file_path, LightsOn=True, BasePlane=PlaneXY(0, 0, 0), Scale=10, Visible=True, PreviewType=0)  # disabled
engine = Engine(
    1,
    Has_Extract_Parameter=False,
    Has_Manage_Collection=False,
    OptionsLength=3,
    Version=1,
    Options=["CPU", "GPU CUDA", "GPU RTX (legacy)"])
quality = Quality(
    4,
    Has_Extract_Parameter=False,
    Has_Manage_Collection=False,
    OptionsLength=6,
    Version=1,
    Options=["Low", "Low+", "Medium", "Medium+", "High", "High+"])

# ----
# QuadPrism
panel_4 = Panel("200")
dom = ConstructDomain(DomainStart=panel_4, DomainEnd="400")
remap_3 = RemapNumbers(Value=gate.Target4, Source=Domain(0, 100), Target=dom)  # -> Mapped, Clipped
qrsettings = QuadRemeshSettings(TargetCount=remap_3.Mapped, AdaptiveSize=0, AdaptiveCount=False, HardEdges=True, SeamEdges=1, Symmetry=0, GuideCurves=0)

# ----
# TriPrism/HexaPrism
relay = Relay([gate.Target2, gate.Target3])
dom_2 = ConstructDomain(DomainStart="0", DomainEnd="18")
remap_4 = RemapNumbers(Value=relay, Source=Domain(0, 100), Target=dom_2)  # -> Mapped, Clipped

subtraction_3 = Subtraction(A=28, B=remap_4.Mapped)

# ----
# Convex
number_slider_8 = Slider(45, range=0..100)
pt_8 = ConstructPoint(XCoordinate=addition, YCoordinate=number_slider_8, ZCoordinate=baseheight)
pt_9 = ConstructPoint(XCoordinate=subtraction, YCoordinate=number_slider_8, ZCoordinate=baseheight)
pt_10 = ConstructPoint(XCoordinate=number_slider_8, YCoordinate=number_slider_8, ZCoordinate=lensthickness)
pt_11 = ConstructPoint(XCoordinate=number_slider_8, YCoordinate=addition, ZCoordinate=baseheight)
pt_12 = Point(pt_8)
pt_13 = Point(pt_11)
pt_14 = Point(pt_9)
pt_15 = Point(pt_10)
sph4pt = Sphere4Pt(Point1=pt_12, Point2=pt_13, Point3=pt_14, Point4=pt_15)  # -> Center, Radius, Sphere

# ----
# NgonalPrism
panel_5 = Panel("20")
dom_3 = ConstructDomain(DomainStart="3", DomainEnd=panel_5)
remap_5 = RemapNumbers(Value=gate.Target5, Source=Domain(0, 100), Target=dom_3)  # -> Mapped, Clipped
pt_16 = Point(Point(45, 45, 0.6))
cir = Circle(Plane=pt_16, Radius=filter_size)
divide = DivideCurve(Curve=cir, Count=remap_5.Mapped, Kinks=False)  # -> Points, Tangents, Parameters
pline = PolyLine(Vertices=divide.Points, Closed=True)
boundary = BoundarySurfaces(Edges=pline)
extr_2 = ExtrudePoint(Base=boundary, Point=pt_10)

# ----
# Prism
pt_17 = ConstructPoint(XCoordinate=number_slider_8, YCoordinate=number_slider_8, ZCoordinate=baseheight)
pt_18 = Point(pt_17)
cone = Cone(Base=pt_18, Radius=filter_size, Length=lensthickness)  # -> Cone, Tip
cap_3 = CapHoles(Brep=cone.Cone)

# ----
# Plates
number_slider_9 = Slider(90, range=0..100)
rectangle = Rectangle(Plane=PlaneXY(0, 0, 0), XSize=number_slider_9, YSize=number_slider_9, Radius=0)  # -> Rectangle, Length
boxrec = BoxRectangle(Rectangle=rectangle.Rectangle, Height=baseheight)

# ----
# Cross
debrep = DeconstructBrep(Brep=rectangle.Rectangle)  # -> Faces, Edges, Vertices
item_2 = ListItem(List=debrep.Edges, Index=1, Wrap=True)
item_3 = ListItem(List=debrep.Edges, Index=2, Wrap=True)
item_4 = ListItem(List=debrep.Edges, Index=3, Wrap=True)
item_5 = ListItem(List=debrep.Edges, Index=4, Wrap=True)
divide_2 = DivideCurve(Curve=item_2, Count=crossdensity, Kinks=False)  # -> Points, Tangents, Parameters
divide_3 = DivideCurve(Curve=item_3, Count=crossdensity, Kinks=False)  # -> Points, Tangents, Parameters
divide_4 = DivideCurve(Curve=item_4, Count=crossdensity, Kinks=False)  # -> Points, Tangents, Parameters
divide_5 = DivideCurve(Curve=item_5, Count=crossdensity, Kinks=False)  # -> Points, Tangents, Parameters
rev = ReverseList(List=divide_4.Points)
rev_2 = ReverseList(List=divide_5.Points)
ln = Line(StartPoint=divide_2.Points, EndPoint=rev)
ln_2 = Line(StartPoint=divide_3.Points, EndPoint=rev_2)
pframes = PerpFrames(Curve=ln, Count=2, Align=True)  # -> Frames, Parameters
pframes_2 = PerpFrames(Curve=ln_2, Count=2, Align=True)  # -> Frames, Parameters
number_slider_10 = Slider(0.1, range=0..0.1)
polygon_2 = Polygon(Plane=pframes_2.Frames, Radius=number_slider_10, Segments=4, FilletRadius=0)  # -> Polygon, Length
polygon_3 = Polygon(Plane=pframes.Frames, Radius=number_slider_10, Segments=4, FilletRadius=0)  # -> Polygon, Length
rotate = Rotate(Geometry=polygon_2.Polygon, Angle=degrees(45), Plane=pframes_2.Frames)  # -> Geometry, Transform
rotate_2 = Rotate(Geometry=polygon_3.Polygon, Angle=degrees(45), Plane=pframes.Frames)  # -> Geometry, Transform
loft = Loft(Curves=rotate.Geometry, Options={Adjust=False, Closed=False, LoftEnds=0, LoftSimp=0, LoftType=0, Rebuild=10, Refit=0.01})
loft_2 = Loft(
    Curves=rotate_2.Geometry,
    Options={Adjust=False, Closed=False, LoftEnds=0, LoftSimp=0, LoftType=0, Rebuild=10, Refit=0.01})
cap_4 = CapHoles(Brep=[loft_2, loft])

ext = ExtendCurve(Curve=ln, Type=0, Start=number_slider_2, End=0)
move = Move(Geometry=ext, Motion=pt)  # -> Geometry, Transform
move_2 = Move(Geometry=ln_2, Motion=pt_2)  # -> Geometry, Transform
end = EndPoints(Curve=ext)  # -> Start, End
end_2 = EndPoints(Curve=move.Geometry)  # -> Start, End
end_3 = EndPoints(Curve=ln_2)  # -> Start, End
end_4 = EndPoints(Curve=move_2.Geometry)  # -> Start, End
ln_3 = Line(StartPoint=end.Start, EndPoint=end_2.Start)
ln_4 = Line(StartPoint=end.End, EndPoint=end_2.End)
ln_5 = Line(StartPoint=end_3.Start, EndPoint=end_4.Start)
ln_6 = Line(StartPoint=end_3.End, EndPoint=end_4.End)
join = JoinCurves(Curves=[ln_2, ln_5, move_2.Geometry, ln_6], Preserve=False)
join_2 = JoinCurves(Curves=[ln_3, move.Geometry, ln_4, ext], Preserve=False)
boundary_2 = BoundarySurfaces(Edges=join_2)
join_3 = JoinCurves(Curves=[join_2, join], Preserve=False)
boundary_3 = BoundarySurfaces(Edges=join)
join_4 = BrepJoin(Breps=boundary_2)  # -> Breps, Closed

sdiff = SolidDifference(BrepsA=sph4pt.Sphere, BrepsB=boxrec)
item_6 = ListItem(List=sdiff, Index=0, Wrap=True)

join_5 = BrepJoin(Breps=boundary_3)  # -> Breps, Closed
runion = RegionUnion(Curves=[join_4.Breps, join_5.Breps])
boundary_4 = BoundarySurfaces(Edges=runion)
gate_2 = StreamGate(Stream=item_6, Gate=lensselector)  # -> Target0, Target1, Target2, Target3, Target4, Target5

triremesh = TriRemesh(Geometry=[gate_2.Target2, gate_2.Target3], Length=subtraction_3, Iterations=100)  # -> Triangulation, Dual, Creases
msh2psrf = MeshToPolysurface(Mesh=triremesh.Triangulation, Triangles=False, FaceMerge=False)
msh2psrf_2 = MeshToPolysurface(Mesh=triremesh.Dual, Triangles=False, FaceMerge=False)

qrmesh = QuadRemesh(Geometry=gate_2.Target4, Settings=qrsettings)
msh2psrf_3 = MeshToPolysurface(Mesh=qrmesh, Triangles=False, FaceMerge=False)

extr_3 = Extrude(Base=boundary_4, Direction=Z)
filter_2 = StreamFilter(
    Gate=lensselector,
    Stream0=item_6,
    Stream1=cap_3,
    Stream2=msh2psrf,
    Stream3=msh2psrf_2,
    Stream4=msh2psrf_3,
    Stream5=extr_2)
merge_2 = Merge(Data1=filter_2, Data2=boxrec)
sunion = SolidUnion(Breps=flatten(merge_2))
bbox = BoundingBox(Content=sunion, Plane=PlaneXY(0, 0, 0))  # -> Box, Box_2
debox = DeconstructBox(Box=bbox.Box)  # -> Plane, X, Y, Z
pt_19 = ConstructPoint(XCoordinate=0, YCoordinate=0, ZCoordinate=debox.Z)
remap_6 = RemapNumbers(Value=halolevel, Source=Slider(100, range=0..100), Target=debox.Z)  # -> Mapped, Clipped

rectangle_2 = Rectangle(Plane=pt_19, XSize=number_slider_9, YSize=number_slider_9, Radius=0)  # -> Rectangle, Length
boxrec_2 = BoxRectangle(Rectangle=rectangle_2.Rectangle, Height=Domain(0, 40))
neg = Negative(Value=remap_6.Mapped)
Z_4 = UnitZ(Factor=neg)
move_3 = Move(Geometry=boxrec_2, Motion=Z_4)  # -> Geometry, Transform

sdiff_2 = SolidDifference(BrepsA=sunion, BrepsB=move_3.Geometry)
bbox_2 = BoundingBox(Content=sdiff_2, Plane=PlaneXY(0, 0, 0))  # -> Box, Box_2
debox_2 = DeconstructBox(Box=bbox_2.Box)  # -> Plane, X, Y, Z
dedomain = DeconstructDomain(Domain=debox_2.Z)  # -> Start, End

# ----
# Text
addition_2 = Addition(A=dedomain.End, B=2)
pt_20 = ConstructPoint(XCoordinate=0, YCoordinate=0, ZCoordinate=addition_2)
pt_21 = Point(pt_20)
text = Text(Location=PlaneXY(45, 45, 0), Text=crossstring, Size=textsize, Bold=True, HorizontalAlignment=0, VerticalAlignment=0)
yz_2 = YZPlane(Origin=Point(45, 45, 0))

boundary_5 = BoundarySurfaces(Edges=text)
debrep_2 = DeconstructBrep(Brep=boundary_5)  # -> Faces, Edges, Vertices
join_6 = JoinCurves(Curves=flatten(debrep_2.Edges), Preserve=False)
offset = OffsetCurve(Curve=join_6, Distance=Slider(0.1, range=0..1), Corners=0)

ext_2 = ExtendCurve(Curve=flatten(offset), Type=2, Start=number_slider_3, End=number_slider_3)
join_7 = JoinCurves(Curves=offset, Preserve=False)

boundary_6 = BoundarySurfaces(Edges=flatten(join_7))

mirror = Mirror(Geometry=boundary_6, Plane=yz_2)  # -> Geometry, Transform
extr_4 = Extrude(Base=mirror.Geometry, Direction=pt_21)  # -> flatten(Extrusion)

sdiff_3 = SolidDifference(BrepsA=sdiff_2, BrepsB=extr_4)
null = NullItem(Item=simplify(extr_4))  # -> NullFlags, InvalidFlags, Description
group = Group(Geometry=extr_4)
filter_3 = StreamFilter(Gate=null.NullFlags, Stream0=sdiff_3, Stream1=sdiff_2)
brep_2 = Brep(filter_3)
sdiff_4 = SolidDifference(BrepsA=brep_2, BrepsB=extr_3)
filter_4 = StreamFilter(Gate=cross, Stream0=brep_2, Stream1=sdiff_4)

# ----
# Mask
mask_radius = Slider(41, range=0..100)
number_slider_11 = Slider(100, range=0..1000)
pt_22 = Point(Point(0, 0, -50))
dom_4 = ConstructDomain(DomainStart=remap_2.Mapped, DomainEnd=remap.Mapped)
pt_23 = Point(Point(45, 45, -50))
rectangle_3 = Rectangle(Plane=pt_22, XSize=dom_4, YSize=Slider(90, range=0..100), Radius=0)  # -> Rectangle, Length
cyl_2 = Cylinder(Base=pt_23, Radius=filter_size, Length=number_slider_11)
boxrec_3 = BoxRectangle(Rectangle=rectangle_3.Rectangle, Height=number_slider_11)
cap_5 = CapHoles(Brep=cyl_2)
sdiff_5 = SolidDifference(BrepsA=filter_4, BrepsB=cap_5)
rotate_3 = Rotate(Geometry=boxrec_3, Angle=degrees(maskangle), Plane=PlaneXY(45, 45, 0))  # -> Geometry, Transform
sint = SolidIntersection(BrepsA=cap_5, BrepsB=rotate_3.Geometry)
sint_2 = SolidIntersection(BrepsA=filter_4, BrepsB=sint)
sdiff_6 = SolidDifference(BrepsA=filter_4, BrepsB=sint)
sunion_2 = SolidUnion(Breps=[sint_2, sdiff_5])

sdiff_7 = SolidDifference(BrepsA=sdiff_6, BrepsB=filter)
sdiff_8 = SolidDifference(BrepsA=sunion_2, BrepsB=filter)
filter_5 = StreamFilter(Gate=mask, Stream0=filter_4, Stream1=sdiff_7, Stream2=sdiff_8)
brep_3 = Brep(filter_5)
c_script = CSharpScript(mesh=filter_5)  # -> base64Draco; inputs mesh: Mesh
# ---------- c_script: C# ----------
    var options = new Rhino.FileIO.DracoCompressionOptions();
    options.CompressionLevel = 5;
    options.IncludeTextureCoordinates = false;
    options.IncludeVertexColors = false;

    var compressed = Rhino.FileIO.DracoCompression.Compress(mesh, options);
    base64Draco = compressed.ToBase64String();
# ---------- end c_script ----------
context_print = ContextPrint(B64Mesh=c_script)
context_bake = ContextBake(MeshGeometry=filter_5)
rotate_4 = Rotate(Geometry=brep_3, Angle=1.570796327, Plane=yz)  # -> Geometry, Transform
rotate_5 = Rotate(Geometry=rotate_4.Geometry, Angle=degrees(Slider(225, range=0..1000)), Plane=PlaneXY(0, 0, 0))  # -> Geometry, Transform
move_4 = Move(Geometry=rotate_5.Geometry, Motion=pt_4)  # -> Geometry, Transform
area = Area(Geometry=move_4.Geometry)  # -> Area, Centroid
move_5 = Move(Geometry=area.Centroid, Motion=Vector(30, -15, 0))  # -> Geometry, Transform
ln_7 = Line(StartPoint=move_5.Geometry, EndPoint=pt_7)
vrot = Rotate(Vector=ln_7, Axis=Z_3, Angle=1.570796327)
vrot_2 = Rotate(Vector=ln_7, Axis=Z_2, Angle=-1.570796327)
pl = ConstructPlane(Origin=move_5.Geometry, XAxis=vrot, YAxis=vrot_2)
flippln = FlipPlane(Plane=pl, FlipX=False, FlipY=False, FlipZ=True)  # -> Flipped, R
orient = Orient(Geometry=brep_3, Source=xy, Target=flippln.Flipped)  # -> Geometry, Transform
rotate_6 = Rotate(Geometry=orient.Geometry, Angle=1.602212253, Plane=ln_7)  # -> Geometry, Transform
vgeo = VRayGeometry(Geo=rotate_6.Geometry, Material=mtl_file_path, Visible=True, quality=3)
camera = VRayCamera(
    Position=move_5.Geometry,
    Target=pt_7,
    FOV=Slider(75, range=0..100),
    Tilt=0,
    OrthographicZoomFactor=0,
    PhysicalExposureOn=True,
    WhiteBalance=RGB(255, 255, 255),
    FNumber=Slider(1.2, range=0..10),
    ShutterSpeed1S=50,
    FilmSensitivity=100,
    AutoExposure=1,
    AutoWhiteBalance=False,
    DepthOfFieldFocus=Slider(2500, range=0..10000))  # -> Camera, Angle, ExposureValue
entwine = Entwine(Branch00=vgeo, Branch01=proxy_scene, FlattenInputs=True)
panel_6 = Panel(camera.ExposureValue)
render = VRayRender(
    Engine=engine,
    Sampler=0,
    Quality=quality,
    OutputResolution=[1920, 1080],
    Camera=camera.Camera,
    VGeometry=flatten(entwine),
    UpdateEffectsFrequency=100)
