# Grasshopper definition lens.gh (Grasshopper 1.0.8)

pt = Point(Point(2, 45, 0.6))
pt_2 = Point(Point(45, 45, 11))
pt_3 = Point(Point(88, 45, 0.6))
pt_4 = Point(Point(45, 88, 0.6))
height_define = Slider(0.6, range=0..1)
number_slider = Slider(90, range=0..100)
height = GetNumber(height_define, AtLeast=1, AtMost=1, Maximum=1.797693135e+308, Minimum=-1.797693135e+308, TreeAccess=False)
rectangle = Rectangle(Plane=PlaneXY(0, 0, 0), XSize=number_slider, YSize=number_slider, Radius=0)  # -> Rectangle, Length
sph4pt = Sphere4Pt(Point1=pt_3, Point2=pt_4, Point3=pt, Point4=pt_2)  # -> Center, Radius, Sphere
boxrec = BoxRectangle(Rectangle=rectangle.Rectangle, Height=height)
sdiff = SolidDifference(BrepsA=sph4pt.Sphere, BrepsB=boxrec)
item = ListItem(List=sdiff, Index=0, Wrap=True)
merge = Merge(Data1=boxrec, Data2=item)
sunion = SolidUnion(Breps=merge)
# Convex/Halo
c_bake = ContextBake(Content=sunion)
