# Grasshopper definition filterworkdesignerforui_vray - heavy.gh (Grasshopper 1.0.8)
# plug-ins: Pufferfish, V-Ray For Grasshopper 8, LunchBox, NGon_RH8

path = FilePath("C:\Users\takeg\Desktop\filterworkdesigner\expressive_optics\test.csv")
file = ReadFile(File=path, PerLineParse=True)
csv = ReadCSV(CSVString=file, Delimiter=",", DataStruct=False)  # -> Headers, Values
panel = Panel(csv.Values)
item = ListItem(List=csv.Values, Index=0, Wrap=True)  # -> Item, Item1, Item2, Item3, Item4, Item5, Item6, Item7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

prism_level = Slider(30, range=0..100)
prismlevel = GetNumber(item.Item4, AtLeast=1, AtMost=1, Maximum=1.797693135e+308, Minimum=-1.797693135e+308, TreeAccess=False)

# ----
# UI
ngonalprism_level = Slider(20, range=3..20)
lens_thickness = Slider(5, range=0..30)
triprism_level = Slider(10, range=10..28)
quadprism_level = Slider(200, range=200..400)
base_height = Slider(0.6, range=0..2)
mask_start = Slider(0, range=0..100)
mask_angle = Slider(0, range=0..360)
hole_size = Slider(10, range=0..100)
mask_end = Slider(88, range=0..100)
halo_level = Slider(10, range=0..20)

cross_density = Slider(10, range=0..100)
text_size = Slider(0, range=0..100)

maskstart = GetNumber(item.Item5, AtLeast=1, AtMost=1, Maximum=1.797693135e+308, Minimum=-1.797693135e+308, TreeAccess=False)
maskend = GetNumber(item.Item6, AtLeast=1, AtMost=1, Maximum=1.797693135e+308, Minimum=-1.797693135e+308, TreeAccess=False)
maskangle = GetNumber(item.Item7, AtLeast=1, AtMost=1, Maximum=1.797693135e+308, Minimum=-1.797693135e+308, TreeAccess=False)
holesize = GetNumber(item.Item8, AtLeast=1, AtMost=1, Maximum=1.797693135e+308, Minimum=-1.797693135e+308, TreeAccess=False)
textsize = GetNumber(item.Item10, AtLeast=1, AtMost=1, Maximum=1.797693135e+308, Minimum=-1.797693135e+308, TreeAccess=False)
crossdensity = GetNumber(item.Item11, AtLeast=1, AtMost=1, Maximum=1.797693135e+308, Minimum=-1.797693135e+308, TreeAccess=False)
lensthickness = GetNumber(item.Item, AtLeast=1, AtMost=1, Maximum=1.797693135e+308, Minimum=-1.797693135e+308, TreeAccess=False)
halolevel = GetNumber(item.Item2, AtLeast=1, AtMost=1, Maximum=1.797693135e+308, Minimum=-1.797693135e+308, TreeAccess=False)
triprismlevel = GetNumber(triprism_level, AtLeast=1, AtMost=1, Maximum=1.797693135e+308, Minimum=-1.797693135e+308, TreeAccess=False)
quadprismlevel = GetNumber(quadprism_level, AtLeast=1, AtMost=1, Maximum=1.797693135e+308, Minimum=-1.797693135e+308, TreeAccess=False)
ngonalprismlevel = GetNumber(ngonalprism_level, AtLeast=1, AtMost=1, Maximum=1.797693135e+308, Minimum=-1.797693135e+308, TreeAccess=False)
baseheight = GetNumber(item.Item1, AtLeast=1, AtMost=1, Maximum=1.797693135e+308, Minimum=-1.797693135e+308, TreeAccess=False)
crossstring = GetString(item.Item9, AtLeast=1, AtMost=1, TreeAccess=False)
number_slider = Slider(0.1, range=0..1)
pt = ConstructPoint(XCoordinate=0, YCoordinate=number_slider, ZCoordinate=0)
pt_2 = ConstructPoint(XCoordinate=number_slider, YCoordinate=0, ZCoordinate=0)

# ----
# Plates
number_slider_2 = Slider(90, range=0..100)
rectangle = Rectangle(Plane=PlaneXY(0, 0, 20), XSize=number_slider_2, YSize=number_slider_2, Radius=0)  # -> Rectangle, Length
rectangle_2 = Rectangle(Plane=PlaneXY(0, 0, 0), XSize=number_slider_2, YSize=number_slider_2, Radius=0)  # -> Rectangle, Length
boxrec = BoxRectangle(Rectangle=rectangle.Rectangle, Height=Domain(0, 40))
boxrec_2 = BoxRectangle(Rectangle=rectangle_2.Rectangle, Height=baseheight)
neg = Negative(Value=halolevel)
Z = UnitZ(Factor=neg)
move = Move(Geometry=boxrec, Motion=Z)  # -> Geometry, Transform

# ----
# Cross
debrep = DeconstructBrep(Brep=rectangle_2.Rectangle)  # -> Faces, Edges, Vertices
item_2 = ListItem(List=debrep.Edges, Index=1, Wrap=True)
item_3 = ListItem(List=debrep.Edges, Index=2, Wrap=True)
item_4 = ListItem(List=debrep.Edges, Index=3, Wrap=True)
item_5 = ListItem(List=debrep.Edges, Index=4, Wrap=True)
divide = DivideCurve(Curve=item_2, Count=crossdensity, Kinks=False)  # -> Points, Tangents, Parameters
divide_2 = DivideCurve(Curve=item_3, Count=crossdensity, Kinks=False)  # -> Points, Tangents, Parameters
divide_3 = DivideCurve(Curve=item_4, Count=crossdensity, Kinks=False)  # -> Points, Tangents, Parameters
divide_4 = DivideCurve(Curve=item_5, Count=crossdensity, Kinks=False)  # -> Points, Tangents, Parameters
rev = ReverseList(List=divide_3.Points)
rev_2 = ReverseList(List=divide_4.Points)
ln = Line(StartPoint=divide.Points, EndPoint=rev)
ln_2 = Line(StartPoint=divide_2.Points, EndPoint=rev_2)
pframes = PerpFrames(Curve=ln, Count=2, Align=True)  # -> Frames, Parameters
pframes_2 = PerpFrames(Curve=ln_2, Count=2, Align=True)  # -> Frames, Parameters
number_slider_3 = Slider(0.1, range=0..0.1)
polygon = Polygon(Plane=pframes_2.Frames, Radius=number_slider_3, Segments=4, FilletRadius=0)  # -> Polygon, Length
polygon_2 = Polygon(Plane=pframes.Frames, Radius=number_slider_3, Segments=4, FilletRadius=0)  # -> Polygon, Length
rotate = Rotate(Geometry=polygon.Polygon, Angle=degrees(45), Plane=pframes_2.Frames)  # -> Geometry, Transform
rotate_2 = Rotate(Geometry=polygon_2.Polygon, Angle=degrees(45), Plane=pframes.Frames)  # -> Geometry, Transform
loft = Loft(Curves=rotate.Geometry, Options={Adjust=False, Closed=False, LoftEnds=0, LoftSimp=0, LoftType=0, Rebuild=10, Refit=0.01})
loft_2 = Loft(
    Curves=rotate_2.Geometry,
    Options={Adjust=False, Closed=False, LoftEnds=0, LoftSimp=0, LoftType=0, Rebuild=10, Refit=0.01})
cap = CapHoles(Brep=[loft_2, loft])

# ----
# Convex
number_slider_4 = Slider(45, range=0..100)
pt_3 = ConstructPoint(XCoordinate=88, YCoordinate=number_slider_4, ZCoordinate=baseheight)
pt_4 = ConstructPoint(XCoordinate=2, YCoordinate=number_slider_4, ZCoordinate=baseheight)
pt_5 = ConstructPoint(XCoordinate=number_slider_4, YCoordinate=number_slider_4, ZCoordinate=lensthickness)
pt_6 = ConstructPoint(XCoordinate=number_slider_4, YCoordinate=88, ZCoordinate=baseheight)
pt_7 = Point(pt_3)
pt_8 = Point(pt_6)
pt_9 = Point(pt_4)
pt_10 = Point(pt_5)
sph4pt = Sphere4Pt(Point1=pt_7, Point2=pt_8, Point3=pt_9, Point4=pt_10)  # -> Center, Radius, Sphere
sdiff = SolidDifference(BrepsA=sph4pt.Sphere, BrepsB=boxrec_2)
item_6 = ListItem(List=sdiff, Index=0, Wrap=True)

# ----
# Prism
pt_11 = ConstructPoint(XCoordinate=number_slider_4, YCoordinate=number_slider_4, ZCoordinate=baseheight)
pt_12 = Point(pt_11)
cone = Cone(Base=pt_12, Radius=Slider(43, range=0..100), Length=lensthickness)  # -> Cone, Tip
cap_2 = CapHoles(Brep=cone.Cone)

ext = ExtendCurve(Curve=ln, Type=0, Start=number_slider, End=0)
move_2 = Move(Geometry=ext, Motion=pt)  # -> Geometry, Transform
move_3 = Move(Geometry=ln_2, Motion=pt_2)  # -> Geometry, Transform
end = EndPoints(Curve=ext)  # -> Start, End
end_2 = EndPoints(Curve=move_2.Geometry)  # -> Start, End
end_3 = EndPoints(Curve=ln_2)  # -> Start, End
end_4 = EndPoints(Curve=move_3.Geometry)  # -> Start, End
ln_3 = Line(StartPoint=end.Start, EndPoint=end_2.Start)
ln_4 = Line(StartPoint=end.End, EndPoint=end_2.End)
ln_5 = Line(StartPoint=end_3.Start, EndPoint=end_4.Start)
ln_6 = Line(StartPoint=end_3.End, EndPoint=end_4.End)
join = JoinCurves(Curves=[ln_2, ln_5, move_3.Geometry, ln_6], Preserve=False)
join_2 = JoinCurves(Curves=[ln_3, move_2.Geometry, ln_4, ext], Preserve=False)
boundary = BoundarySurfaces(Edges=join_2)
join_3 = JoinCurves(Curves=[join_2, join], Preserve=False)
boundary_2 = BoundarySurfaces(Edges=join)
join_4 = BrepJoin(Breps=boundary)  # -> Breps, Closed
join_5 = BrepJoin(Breps=boundary_2)  # -> Breps, Closed
runion = RegionUnion(Curves=[join_4.Breps, join_5.Breps])
boundary_3 = BoundarySurfaces(Edges=runion)
Z_2 = UnitZ(Factor=Slider(0.05, range=0..0.1))
extr = Extrude(Base=boundary_3, Direction=Z_2)
list = ValueList({"Convex": 0, "Prism": 1, "TriPrism": 2, "HexaPrism": 3, "QuadPrism": 4, "NgonalPrism": 5}, selected="Convex")
lensselector = GetString(item.Item3, AtLeast=1, AtMost=1, TreeAccess=False)
gate = StreamGate(Stream=prismlevel, Gate=lensselector)  # -> Target0, Target1, Target2, Target3, Target4, Target5

# ----
# NgonalPrism
panel_2 = Panel("20")
dom = ConstructDomain(DomainStart="3", DomainEnd=panel_2)
remap = RemapNumbers(Value=gate.Target5, Source=Domain(0, 100), Target=dom)  # -> Mapped, Clipped
pt_13 = Point(Point(45, 45, 0.6))
cir = Circle(Plane=pt_13, Radius=Slider(43, range=0..100))
divide_5 = DivideCurve(Curve=cir, Count=remap.Mapped, Kinks=False)  # -> Points, Tangents, Parameters
pline = PolyLine(Vertices=divide_5.Points, Closed=True)
boundary_4 = BoundarySurfaces(Edges=pline)
extr_2 = ExtrudePoint(Base=boundary_4, Point=pt_5)

gate_2 = StreamGate(Stream=item_6, Gate=lensselector)  # -> Target0, Target1, Target2, Target3, Target4, Target5

# ----
# QuadPrism
panel_3 = Panel("200")
dom_2 = ConstructDomain(DomainStart=panel_3, DomainEnd="400")
remap_2 = RemapNumbers(Value=gate.Target4, Source=Domain(0, 100), Target=dom_2)  # -> Mapped, Clipped
qrsettings = QuadRemeshSettings(TargetCount=remap_2.Mapped, AdaptiveSize=0, AdaptiveCount=False, HardEdges=True, SeamEdges=1, Symmetry=0, GuideCurves=0)
qrmesh = QuadRemesh(Geometry=gate_2.Target4, Settings=qrsettings)
msh2psrf = MeshToPolysurface(Mesh=qrmesh, Triangles=False, FaceMerge=False)

# ----
# TriPrism/HexaPrism
relay = Relay([gate.Target2, gate.Target3])
dom_3 = ConstructDomain(DomainStart="10", DomainEnd="28")
remap_3 = RemapNumbers(Value=relay, Source=Domain(0, 100), Target=dom_3)  # -> Mapped, Clipped
triremesh = TriRemesh(Geometry=[gate_2.Target2, gate_2.Target3], Length=remap_3.Mapped, Iterations=100)  # -> Triangulation, Dual, Creases
msh2psrf_2 = MeshToPolysurface(Mesh=triremesh.Triangulation, Triangles=False, FaceMerge=False)
msh2psrf_3 = MeshToPolysurface(Mesh=triremesh.Dual, Triangles=False, FaceMerge=False)

filter = StreamFilter(
    Gate=lensselector,
    Stream0=item_6,
    Stream1=cap_2,
    Stream2=msh2psrf_2,
    Stream3=msh2psrf_3,
    Stream4=msh2psrf,
    Stream5=extr_2)
merge = Merge(Data1=filter, Data2=boxrec_2)
sunion = SolidUnion(Breps=flatten(merge))
number_slider_5 = Slider(10, range=0..10)
sdiff_2 = SolidDifference(BrepsA=sunion, BrepsB=move.Geometry)
bbox = BoundingBox(Content=sdiff_2, Plane=PlaneXY(0, 0, 0))  # -> Box, Box_2
debrep_2 = DeconstructBrep(Brep=bbox.Box)  # -> Faces, Edges, Vertices
item_7 = ListItem(List=debrep_2.Faces, Index=4, Wrap=True)
number_slider_6 = Slider(15, range=0..100)
debox = DeconstructBox(Box=bbox.Box)  # -> Plane, X, Y, Z
pt_14 = Point(Point(-25, -25, 0))
dedomain = DeconstructDomain(Domain=debox.Z)  # -> Start, End

# ----
# Text
addition = Addition(A=dedomain.End, B=2)
pt_15 = ConstructPoint(XCoordinate=0, YCoordinate=0, ZCoordinate=addition)
pt_16 = Point(pt_15)
text = Text(Location=PlaneXY(45, 45, 0), Text=crossstring, Size=textsize, Bold=True, HorizontalAlignment=0, VerticalAlignment=0)
yz = YZPlane(Origin=Point(45, 45, 0))
mirror = Mirror(Geometry=text, Plane=yz)  # -> Geometry, Transform
boundary_5 = BoundarySurfaces(Edges=mirror.Geometry)
extr_3 = Extrude(Base=boundary_5, Direction=pt_16)  # -> flatten(Extrusion); disabled

sunion_2 = SolidUnion(Breps=[extr_3, sdiff_2])
rectangle_3 = Rectangle(Plane=PlaneXY(0, 0, 0), XSize=number_slider_6, YSize=number_slider_6, Radius=0)  # -> Rectangle, Length
number_slider_7 = Slider(100, range=0..100)
brep = Brep(sunion_2)
list_2 = ValueList({"No Cross": 0, "Cross": 1}, selected="Cross")
cross = GetNumber(item.Item13, AtLeast=1, AtMost=1, Maximum=1.797693135e+308, Minimum=-1.797693135e+308, Prompt="mask", TreeAccess=False)
number_slider_8 = Slider(1, range=0..1)
remap_4 = RemapNumbers(Value=maskstart, Source=Domain(0, 100), Target=Domain(0, 88))  # -> Mapped, Clipped
remap_5 = RemapNumbers(Value=maskend, Source=Domain(0, 100), Target=Domain(0, 88))  # -> Mapped, Clipped
number_slider_9 = Slider(1, range=0..1)
mask = GetNumber(item.Item12, AtLeast=1, AtMost=1, Maximum=1.797693135e+308, Minimum=-1.797693135e+308, Prompt="mask", TreeAccess=False)
list_3 = ValueList({"No Mask": 0, "PosiMask": 1, "NegaMask": 2}, selected="NegaMask")
merge_2 = Merge(
    Data1=lens_thickness,
    Data2=base_height,
    Data3=halo_level,
    Data4=list,
    Data5=prism_level,
    Data6=mask_start,
    Data7=mask_end,
    Data8=mask_angle,
    Data9=hole_size,
    Data10="UIST",
    Data11=text_size,
    Data12=cross_density,
    Data13=list_3,
    Data14=list_2)
csv_2 = CreateCSV(DataGridHeaders="Lens Parameters", ValueTree=simplify(merge_2), Delimiter=",", QuoteItems=False, DataStruct=False)
excelwrite = ExcelWriter(
    WriteExcelData=False,
    WorksheetName="Sheet1",
    ColumnHeadings="Lens Parameters",
    Data=csv_2,
    ClearSheet=False,
    DataStruct=False)
panel_4 = Panel(csv_2)
number_slider_10 = Slider(4, range=0..20)
pt_17 = Point(Point(45, 45, -1))
polygon_3 = Polygon(Plane=pt_17, Radius=holesize, Segments=number_slider_10, FilletRadius=0)  # -> Polygon, Length
cyl = Cylinder(Base=PlaneXY(45, 45, -1), Radius=holesize, Length=20)
extr_4 = Extrude(Base=polygon_3.Polygon, Direction=Vector(0, 0, 20))
cap_3 = CapHoles(Brep=cyl)
larger = LargerThan(FirstNumber=number_slider_10, SecondNumber=2)  # -> LargerThan, OrEqualTo
cap_4 = CapHoles(Brep=extr_4)
filter_2 = StreamFilter(Gate=larger.LargerThan, Stream0=cap_3, Stream1=cap_4)
panel_5 = Panel(larger.LargerThan)
brep_2 = Brep(filter_2)
yz_2 = YZPlane(Origin=Point(0, 0, 0))
number_slider_11 = Slider(100, range=0..100)
subtraction = Subtraction(A=Slider(0, range=0..10), B=Slider(15, range=0..100))
pt_18 = ConstructPoint(XCoordinate=number_slider_11, YCoordinate=number_slider_11, ZCoordinate=Slider(1621, range=0..10000))
neg_2 = Negative(Value=Slider(39, range=0..100))
pt_19 = ConstructPoint(XCoordinate=Slider(30, range=0..100), YCoordinate=subtraction, ZCoordinate=0)
mtl_file_path = VRayMaterialFromFile(
    "C:\Users\takeg\Desktop\filterwork\YoshimotoGlass.vrmat",
    File_Picker=0,
    File_Types="V-Ray materials (*.vrmat)|*.vrmat",
    Multiple_Files=True)
pt_20 = Point(Point(3000, -7500, 1521.899032))
pt_21 = Point(pt_19)
proxy_scene = VRayProxyScene(
    FilePath="C:\Users\takeg\Desktop\filterwork\scenetest\Rhino_interior_day_HQ.vrscene",
    LightsOn=True,
    BasePlane=PlaneXY(0, 0, 0),
    Scale=10,
    Visible=True,
    PreviewType=0)
pt_22 = Point(Point(2960, -7527, 1566))
engine = Engine(
    1,
    Has_Extract_Parameter=False,
    Has_Manage_Collection=False,
    OptionsLength=3,
    Version=1,
    Options=["CPU", "GPU CUDA", "GPU RTX (legacy)"])

boundary_6 = BoundarySurfaces(Edges=text)
debrep_3 = DeconstructBrep(Brep=boundary_6)  # -> Faces, Edges, Vertices
join_6 = JoinCurves(Curves=debrep_3.Edges, Preserve=False)
neg_3 = Negative(Value=Slider(0.1, range=0..1))
offset = OffsetCurve(Curve=join_6, Distance=neg_3, Corners=3)
boundary_7 = BoundarySurfaces(Edges=flatten(offset))
Z_3 = UnitZ(Factor=Slider(0.5, range=0..1))

boundary_8 = BoundarySurfaces(Edges=flatten(join_6))

rdiff = RegionDifference(CurvesA=boundary_8, CurvesB=boundary_7)
boundary_9 = BoundarySurfaces(Edges=rdiff)
extr_5 = Extrude(Base=boundary_9, Direction=Z_3)

move_4 = Move(Geometry=extr_5, Motion=pt_14)  # -> Geometry, Transform
scale = Scale(Geometry=move_4.Geometry, Center=Point(0, 0, 0), Factor=0.4)  # -> Geometry, Transform
arrrec = RectangularArray(Geometry=scale.Geometry, Cell=rectangle_3.Rectangle, XCount=6, YCount=6)  # -> Geometry, Transform
sdiff_3 = SolidDifference(BrepsA=brep, BrepsB=flatten(arrrec.Geometry))
filter_3 = StreamFilter(Gate=cross, Stream0=brep, Stream1=sdiff_3)

# ----
# Mask
mask_radius = Slider(43, range=0..100)
number_slider_12 = Slider(100, range=0..1000)
dom_4 = ConstructDomain(DomainStart=remap_4.Mapped, DomainEnd=remap_5.Mapped)
pt_23 = Point(Point(45, 45, -50))
pt_24 = Point(Point(0, 0, -50))
rectangle_4 = Rectangle(Plane=pt_24, XSize=dom_4, YSize=Slider(90, range=0..100), Radius=0)  # -> Rectangle, Length
cyl_2 = Cylinder(Base=pt_23, Radius=mask_radius, Length=number_slider_12)
boxrec_3 = BoxRectangle(Rectangle=rectangle_4.Rectangle, Height=number_slider_12)
cap_5 = CapHoles(Brep=cyl_2)
sdiff_4 = SolidDifference(BrepsA=filter_3, BrepsB=cap_5)
rotate_3 = Rotate(Geometry=boxrec_3, Angle=degrees(maskangle), Plane=PlaneXY(45, 45, 0))  # -> Geometry, Transform
sint = SolidIntersection(BrepsA=cap_5, BrepsB=rotate_3.Geometry)
sint_2 = SolidIntersection(BrepsA=filter_3, BrepsB=sint)
sdiff_5 = SolidDifference(BrepsA=filter_3, BrepsB=sint)
sunion_3 = SolidUnion(Breps=[sint_2, sdiff_4])

sdiff_6 = SolidDifference(BrepsA=sdiff_5, BrepsB=filter_2)
sdiff_7 = SolidDifference(BrepsA=sunion_3, BrepsB=filter_2)
filter_4 = StreamFilter(Gate=mask, Stream0=filter_3, Stream1=sdiff_6, Stream2=sdiff_7)
brep_3 = Brep(filter_4)
c_script = CSharpScript(mesh=filter_4)  # -> base64Draco; inputs mesh: Mesh
# ---------- c_script: C# ----------
    var options = new Rhino.FileIO.DracoCompressionOptions();
    options.CompressionLevel = 5;
    options.IncludeTextureCoordinates = false;
    options.IncludeVertexColors = false;

    var compressed = Rhino.FileIO.DracoCompression.Compress(mesh, options);
    base64Draco = compressed.ToBase64String();
# ---------- end c_script ----------
context_print = ContextPrint(B64Mesh=c_script)
context_bake = ContextBake(MeshGeometry=filter_4)
rotate_4 = Rotate(Geometry=brep_3, Angle=1.570796327, Plane=yz_2)  # -> Geometry, Transform
rotate_5 = Rotate(Geometry=rotate_4.Geometry, Angle=degrees(Slider(225, range=0..1000)), Plane=PlaneXY(0, 0, 0))  # -> Geometry, Transform
move_5 = Move(Geometry=rotate_5.Geometry, Motion=pt_20)  # -> Geometry, Transform
area = Area(Geometry=move_5.Geometry)  # -> Area, Centroid
panel_6 = Panel(area.Centroid)
move_6 = Move(Geometry=area.Centroid, Motion=pt_21)  # -> Geometry, Transform
vgeo = VRayGeometry(Geo=move_5.Geometry, Material=mtl_file_path, Visible=True, quality=2)
camera = VRayCamera(
    Position=move_6.Geometry,
    Target=pt_22,
    FOV=Slider(73.7, range=0..100),
    Tilt=0,
    OrthographicZoomFactor=0,
    PhysicalExposureOn=True,
    WhiteBalance=RGB(255, 255, 255),
    FNumber=8,
    ShutterSpeed1S=50,
    FilmSensitivity=100,
    AutoExposure=1,
    AutoWhiteBalance=False,
    DepthOfFieldFocus=0)  # -> Camera, Angle, ExposureValue
entwine = Entwine(Branch00=vgeo, Branch01=proxy_scene, FlattenInputs=True)
panel_7 = Panel(camera.ExposureValue)
render = VRayRender(
    Engine=engine,
    Sampler=0,
    Quality=5,
    OutputResolution=[2000, 2000],
    Camera=camera.Camera,
    VGeometry=flatten(entwine),
    UpdateEffectsFrequency=100)
